test file "Conceptual design phase"

suite "Model linearization"

  case "Linearization test 1" [baseline]
    model plant_VV_l, harness plant_VV_l_Harness
    signal scenario: Doublet_T (plant_VV_l_Harness/Signal Editor)
    baseline "linarization_baseline_1.mat"
      Xe:1: abs tol 0.001
      Ve:1: abs tol 0.001
      Att:1: abs tol 0.0001
      Omega:1: abs tol 0.0001

  case "Linearization test 2" [baseline]
    model plant_VV_l, harness plant_VV_l_Harness, stop time 5
    signal scenario: Doublet_Mx (plant_VV_l_Harness/Signal Editor)
    baseline "linarization_baseline_2.mat"
      Xe:1: abs tol 0.001
      Ve:1: abs tol 0.001
      Att:1: abs tol 0.0001
      Omega:1: abs tol 0.0001

  case "Linearization test 3" [baseline]
    model plant_VV_l, harness plant_VV_l_Harness, stop time 5
    signal scenario: Doublet_My (plant_VV_l_Harness/Signal Editor)
    baseline "linarization_baseline_3.mat"
      Xe:1: abs tol 0.001
      Ve:1: abs tol 0.001
      Att:1: abs tol 0.0001
      Omega:1: abs tol 0.0001

  case "Linearization test 4" [baseline]
    model plant_VV_l, harness plant_VV_l_Harness
    signal scenario: Doublet_Mz (plant_VV_l_Harness/Signal Editor)
    baseline "linarization_baseline_4.mat": rel tol 0.001
      Xe:1: abs tol 0.001, rel tol 0.001
      Ve:1: abs tol 0.001, rel tol 0.001
      Att:1: abs tol 0.0001, rel tol 0.001
      Omega:1: abs tol 0.0001, rel tol 0.001

suite "Requirements verification"

  suite "Re-GNC-Prelim-01"
    description: The drone control system shall be robust

    case "Re-GNC-Prelim-01.1" [simulation]
      description: The gain margin for the angular velocity feedback loop shall be infinite
      model plant_control_1
      custom criteria:
        TF1 = tf(sltest_simout.sys1_1_1.values);
        TF2 = tf(sltest_simout.sys1_2_1.values);
        TF3 = tf(sltest_simout.sys1_3_1.values);

        [Gm1,~,~,~] = margin(TF1);
        [Gm2,~,~,~] = margin(TF2);
        [Gm3,~,~,~] = margin(TF3);

        test.assertEqual(Gm1, Inf, 'The gain margin shall be infinite');
        test.assertEqual(Gm2, Inf, 'The gain margin shall be infinite');
        test.assertEqual(Gm3, Inf, 'The gain margin shall be infinite');

    case "Re-GNC-Prelim-01.2" [simulation]
      description: The gain margin for the attitude feedback loop shall be infinite
      model plant_control_2
      custom criteria:
        TF1 = tf(sltest_simout.sys2_1_1.values);
        TF2 = tf(sltest_simout.sys2_2_1.values);
        TF3 = tf(sltest_simout.sys2_3_1.values);

        [Gm1,~,~,~] = margin(TF1);
        [Gm2,~,~,~] = margin(TF2);
        [Gm3,~,~,~] = margin(TF3);

        test.assertEqual(Gm1, Inf, 'The gain margin shall be infinite');
        test.assertEqual(Gm2, Inf, 'The gain margin shall be infinite');
        test.assertEqual(Gm3, Inf, 'The gain margin shall be infinite');

    case "Re-GNC-Prelim-01.3" [simulation]
      description: The gain margin for the velocity feedback loop shall be more than 100dB
      model plant_control_3
      custom criteria:
        TF1 = tf(sltest_simout.sys3_1_1.values);
        TF2 = tf(sltest_simout.sys3_2_1.values);
        TF3 = tf(sltest_simout.sys3_3_1.values);

        [Gm1,~,~,~] = margin(TF1);
        [Gm2,~,~,~] = margin(TF2);
        [Gm3,~,~,~] = margin(TF3);

        test.assertGreaterThan(Gm1, 5, 'The gain margin shall be greater than 100dB');
        test.assertGreaterThan(Gm2, 5, 'The gain margin shall be greater than 100dB');
        test.assertGreaterThanOrEqual(Gm3, 0, 'The gain margin shall be greater than 100dB');

    case "Re-GNC-Prelim-01.4" [simulation]
      description: The gain margin for the velocity feedback loop shall be more than 25dB
      model plant_control_4
      custom criteria:
        TF1 = tf(sltest_simout.sys4_1_1.values);
        TF2 = tf(sltest_simout.sys4_2_1.values);
        TF3 = tf(sltest_simout.sys4_3_1.values);

        [Gm1,~,~,~] = margin(TF1);
        [Gm2,~,~,~] = margin(TF2);
        [Gm3,~,~,~] = margin(TF3);

        test.assertGreaterThan(Gm1, 25, 'The gain margin shall be more than 25dB');
        test.assertGreaterThan(Gm2, 25, 'The gain margin shall be more than 25dB');
        test.assertGreaterThan(Gm3, 25, 'The gain margin shall be more than 25dB');

  suite "Re-GNC-Prelim-02"
    description: The drone control system shall have a desirable performance

    case "Re-GNC-Prelim-02.1" [simulation]
      description: The cross-over frequency for the angular velocity feedback loop shall be 25 rad/s (+- 1%)
      model plant_control_1
      custom criteria:
        TF1 = tf(sltest_simout.sys1_1_1.values);
        TF2 = tf(sltest_simout.sys1_2_1.values);
        TF3 = tf(sltest_simout.sys1_3_1.values);

        [~,~,~,Wcp1] = margin(TF1);
        [~,~,~,Wcp2] = margin(TF2);
        [~,~,~,Wcp3] = margin(TF3);

        test.assertEqual(Wcp1, 25, 'The cross-over frequency should be 25 rad/s', 'RelTol', 0.01);
        test.assertEqual(Wcp2, 25, 'The cross-over frequency should be 25 rad/s', 'RelTol', 0.01);
        test.assertEqual(Wcp3, 25, 'The cross-over frequency should be 25 rad/s', 'RelTol', 0.01);

    case "Re-GNC-Prelim-02.2" [simulation]
      description: The cross-over frequency for the attitude feedback loop shall be 10 rad/s (+- 1%)
      model plant_control_2
      custom criteria:
        TF1 = tf(sltest_simout.sys2_1_1.values);
        TF2 = tf(sltest_simout.sys2_2_1.values);
        TF3 = tf(sltest_simout.sys2_3_1.values);

        [~,~,~,Wcp1] = margin(TF1);
        [~,~,~,Wcp2] = margin(TF2);
        [~,~,~,Wcp3] = margin(TF3);

        test.assertEqual(Wcp1, 10, 'The cross-over frequency should be 25 rad/s', 'RelTol', 0.01);
        test.assertEqual(Wcp2, 10, 'The cross-over frequency should be 25 rad/s', 'RelTol', 0.01);
        test.assertEqual(Wcp3, 10, 'The cross-over frequency should be 25 rad/s', 'RelTol', 0.01);

    case "Re-GNC-Prelim-02.3" [simulation]
      description: The cross-over frequency for the velocity feedback loop shall be 10 rad/s (+- 10%)
      model plant_control_3
      custom criteria:
        TF1 = tf(sltest_simout.sys3_1_1.values);
        TF2 = tf(sltest_simout.sys3_2_1.values);
        TF3 = tf(sltest_simout.sys3_3_1.values);

        [~,~,~,Wcp1] = margin(TF1);
        [~,~,~,Wcp2] = margin(TF2);
        [~,~,~,Wcp3] = margin(TF3);

        test.assertEqual(Wcp1, 10, 'The cross-over frequency should be 10 rad/s', 'RelTol', 0.1);
        test.assertEqual(Wcp2, 10, 'The cross-over frequency should be 10 rad/s', 'RelTol', 0.1);
        test.assertEqual(Wcp3, 10, 'The cross-over frequency should be 10 rad/s', 'RelTol', 0.1);

    case "Re-GNC-Prelim-02.4" [simulation]
      description: The cross-over frequency for the position feedback loop shall be 1 rad/s (+- 5%)
      model plant_control_4
      custom criteria:
        TF1 = tf(sltest_simout.sys4_1_1.values);
        TF2 = tf(sltest_simout.sys4_2_1.values);
        TF3 = tf(sltest_simout.sys4_3_1.values);

        [~,~,~,Wcp1] = margin(TF1);
        [~,~,~,Wcp2] = margin(TF2);
        [~,~,~,Wcp3] = margin(TF3);

        test.assertEqual(Wcp1, 1, 'The cross-over frequency should be 1 rad/s', 'RelTol', 0.05);
        test.assertEqual(Wcp2, 1, 'The cross-over frequency should be 1 rad/s', 'RelTol', 0.05);
        test.assertEqual(Wcp3, 1, 'The cross-over frequency should be 1 rad/s', 'RelTol', 0.05);

    case "Re-GNC-Prelim-02.5" [simulation]
      description: The angular velocity feedback loop shall have 0% overshoot
      model plant_control_1
      custom criteria:
        TF1 = tf(sltest_simout.sys1_1_2.values);
        TF2 = tf(sltest_simout.sys1_2_2.values);
        TF3 = tf(sltest_simout.sys1_3_2.values);

        overshoot_1 = stepinfo(TF1).Overshoot;
        overshoot_2 = stepinfo(TF2).Overshoot;
        overshoot_3 = stepinfo(TF3).Overshoot;

        test.assertLessThanOrEqual(overshoot_1, 0, 'The overshoot shall be less than 0%');
        test.assertLessThanOrEqual(overshoot_2, 0, 'The overshoot shall be less than 0%');
        test.assertLessThanOrEqual(overshoot_3, 0, 'The overshoot shall be less than 0%');

    case "Re-GNC-Prelim-02.6" [simulation]
      description: The attitude feedback loop shall have less than 10% overshoot
      model plant_control_2
      custom criteria:
        TF1 = tf(sltest_simout.sys2_1_2.values);
        TF2 = tf(sltest_simout.sys2_2_2.values);
        TF3 = tf(sltest_simout.sys2_3_2.values);

        overshoot_1 = stepinfo(TF1).Overshoot;
        overshoot_2 = stepinfo(TF2).Overshoot;
        overshoot_3 = stepinfo(TF3).Overshoot;

        test.assertLessThanOrEqual(overshoot_1, 10, 'The overshoot shall be less than 10%');
        test.assertLessThanOrEqual(overshoot_2, 10, 'The overshoot shall be less than 10%');
        test.assertLessThanOrEqual(overshoot_3, 10, 'The overshoot shall be less than 10%');

    case "Re-GNC-Prelim-02.7" [simulation]
      description: The velocity feedback loop shall have less than 10% overshoot
      model plant_control_3
      custom criteria:
        TF1 = tf(sltest_simout.sys3_1_2.values);
        TF2 = tf(sltest_simout.sys3_2_2.values);
        TF3 = tf(sltest_simout.sys3_3_2.values);

        overshoot_1 = stepinfo(TF1).Overshoot;
        overshoot_2 = stepinfo(TF2).Overshoot;
        overshoot_3 = stepinfo(TF3).Overshoot;

        test.assertLessThanOrEqual(overshoot_1, 10, 'The overshoot shall be less than 10%');
        test.assertLessThanOrEqual(overshoot_2, 10, 'The overshoot shall be less than 10%');
        test.assertLessThanOrEqual(overshoot_3, 10, 'The overshoot shall be less than 10%');

    case "Re-GNC-Prelim-02.8" [simulation]
      description: The position feedback loop shall have less than 10% overshoot
      model plant_control_4
      custom criteria:
        TF1 = tf(sltest_simout.sys4_1_2.values);
        TF2 = tf(sltest_simout.sys4_2_2.values);
        TF3 = tf(sltest_simout.sys4_3_2.values);

        overshoot_1 = stepinfo(TF1).Overshoot;
        overshoot_2 = stepinfo(TF2).Overshoot;
        overshoot_3 = stepinfo(TF3).Overshoot;

        test.assertLessThanOrEqual(overshoot_1, 10, 'The overshoot shall be less than 10%');
        test.assertLessThanOrEqual(overshoot_2, 10, 'The overshoot shall be less than 10%');
        test.assertLessThanOrEqual(overshoot_3, 10, 'The overshoot shall be less than 10%');

    case "Re-GNC-Prelim-02.9" [simulation]
      description: The drone shall not pitch more than 60 deg
      model plant_control, harness plant_control_Harness
      custom criteria:
        data=find(sltest_simout.yout, "pitch").Values.Data;
        max_angle=max(data);

        test.assertLessThan(max_angle, 60, "The pitch angle shall be less than 60 deg")

    case "Re-GNC-Prelim-02.10" [simulation]
      description: The drone shall not roll more than 60 deg
      model plant_control, harness plant_control_Harness
      custom criteria:
        data = find(sltest_simout.yout, "roll").Values.Data;
        max_data = max(data);

        test.assertLessThan(max_data, 60, "The roll angle shall be less than 60 deg")

  suite "Re-GNC-Prelim-03"
    description: The control system shall be stable

    case "Re-GNC-Prelim-03.1" [simulation]
      description: The angular velocity feedback loop shall have positive gain margins
      model plant_control_1
      custom criteria:
        TF1 = tf(sltest_simout.sys1_1_1.values);
        TF2 = tf(sltest_simout.sys1_2_1.values);
        TF3 = tf(sltest_simout.sys1_3_1.values);

        [Gm1,Pm1,~,~] = margin(TF1);
        [Gm2,Pm2,~,~] = margin(TF2);
        [Gm3,Pm3,~,~] = margin(TF3);

        test.assertGreaterThanOrEqual(Gm1, 0, 'The gain margin shall be greater than 0dB');
        test.assertGreaterThanOrEqual(Gm2, 0, 'The gain margin shall be greater than 0dB');
        test.assertGreaterThanOrEqual(Gm3, 0, 'The gain margin shall be greater than 0dB');

        test.assertGreaterThanOrEqual(Pm1, 0, 'The phase margin shall be greater than 0dB');
        test.assertGreaterThanOrEqual(Pm2, 0, 'The phase margin shall be greater than 0dB');
        test.assertGreaterThanOrEqual(Pm3, 0, 'The phase margin shall be greater than 0dB');

    case "Re-GNC-Prelim-03.2" [simulation]
      description: The attitude feedback loop shall have positive gain margins
      model plant_control_2
      custom criteria:
        TF1 = tf(sltest_simout.sys2_1_1.values);
        TF2 = tf(sltest_simout.sys2_2_1.values);
        TF3 = tf(sltest_simout.sys2_3_1.values);

        [Gm1,Pm1,~,~] = margin(TF1);
        [Gm2,Pm2,~,~] = margin(TF2);
        [Gm3,Pm3,~,~] = margin(TF3);

        test.assertGreaterThanOrEqual(Gm1, 0, 'The gain margin shall be greater than 0dB');
        test.assertGreaterThanOrEqual(Gm2, 0, 'The gain margin shall be greater than 0dB');
        test.assertGreaterThanOrEqual(Gm3, 0, 'The gain margin shall be greater than 0dB');

        test.assertGreaterThanOrEqual(Pm1, 0, 'The phase margin shall be greater than 0dB');
        test.assertGreaterThanOrEqual(Pm2, 0, 'The phase margin shall be greater than 0dB');
        test.assertGreaterThanOrEqual(Pm3, 0, 'The phase margin shall be greater than 0dB');

    case "Re-GNC-Prelim-03.3" [simulation]
      description: The velocity feedback loop shall have positive gain margins
      model plant_control_3
      custom criteria:
        TF1 = tf(sltest_simout.sys3_1_1.values);
        TF2 = tf(sltest_simout.sys3_2_1.values);
        TF3 = tf(sltest_simout.sys3_3_1.values);

        [Gm1,Pm1,~,~] = margin(TF1);
        [Gm2,Pm2,~,~] = margin(TF2);
        [Gm3,Pm3,~,~] = margin(TF3);

        test.assertGreaterThanOrEqual(Gm1, 0, 'The gain margin shall be greater than 0dB');
        test.assertGreaterThanOrEqual(Gm2, 0, 'The gain margin shall be greater than 0dB');
        test.assertGreaterThanOrEqual(Gm3, 0, 'The gain margin shall be greater than 0dB');

        test.assertGreaterThanOrEqual(Pm1, 0, 'The phase margin shall be greater than 0dB');
        test.assertGreaterThanOrEqual(Pm2, 0, 'The phase margin shall be greater than 0dB');
        test.assertGreaterThanOrEqual(Pm3, 0, 'The phase margin shall be greater than 0dB');

    case "Re-GNC-Prelim-03.4" [simulation]
      description: The position feedback loop shall have positive gain margins
      model plant_control_4
      custom criteria:
        TF1 = tf(sltest_simout.sys4_1_1.values);
        TF2 = tf(sltest_simout.sys4_2_1.values);
        TF3 = tf(sltest_simout.sys4_3_1.values);

        [Gm1,Pm1,~,~] = margin(TF1);
        [Gm2,Pm2,~,~] = margin(TF2);
        [Gm3,Pm3,~,~] = margin(TF3);

        test.assertGreaterThanOrEqual(Gm1, 0, 'The gain margin shall be greater than 0dB');
        test.assertGreaterThanOrEqual(Gm2, 0, 'The gain margin shall be greater than 0dB');
        test.assertGreaterThanOrEqual(Gm3, 0, 'The gain margin shall be greater than 0dB');

        test.assertGreaterThanOrEqual(Pm1, 0, 'The phase margin shall be greater than 0dB');
        test.assertGreaterThanOrEqual(Pm2, 0, 'The phase margin shall be greater than 0dB');
        test.assertGreaterThanOrEqual(Pm3, 0, 'The phase margin shall be greater than 0dB');