% Requirement links of control_law_design.m (R2023a)

% lines 63-65 relates to GNC_preliminary_requirements.slreqx#21
% lines 63-65 relates to GNC_preliminary_requirements.slreqx#26
% lines 63-65 relates to GNC_preliminary_requirements.slreqx#37
% lines 63-65 relates to GNC_preliminary_requirements.slreqx#30
Kp_p = 2.874;
Kp_q = 2.874;
Kp_r = 1.3536;

% line 65 relates to GNC_preliminary_requirements.slreqx#21
% line 65 relates to GNC_preliminary_requirements.slreqx#26
% line 65 relates to GNC_preliminary_requirements.slreqx#37
% line 65 relates to GNC_preliminary_requirements.slreqx#30
Kp_r = 1.3536;

% lines 92-94 relates to GNC_preliminary_requirements.slreqx#22
% lines 92-94 relates to GNC_preliminary_requirements.slreqx#27
% lines 92-94 relates to GNC_preliminary_requirements.slreqx#38
% lines 92-94 relates to GNC_preliminary_requirements.slreqx#33
Kp_roll = 5.6234;
Kp_pitch = 5.6234;
Kp_yaw = 5.6234;

% lines 122-126 relates to GNC_preliminary_requirements.slreqx#24
% lines 122-126 relates to GNC_preliminary_requirements.slreqx#28
% lines 122-126 relates to GNC_preliminary_requirements.slreqx#39
% lines 122-126 relates to GNC_preliminary_requirements.slreqx#34
Kp_vx = -0.2723;
Kp_vy = 0.2723;
Kp_vz = 100;
Td = 1/3;
Ti = 5/3;

% lines 156-158 relates to GNC_preliminary_requirements.slreqx#25
% lines 156-158 relates to GNC_preliminary_requirements.slreqx#36
% lines 156-158 relates to GNC_preliminary_requirements.slreqx#40
% lines 156-158 relates to GNC_preliminary_requirements.slreqx#35
Kp_x = 1;
Kp_y = 1;
Kp_z = 1;