test file "SIL_tests"

suite "Navigation"

  case "Test Case 1" [baseline]
    description: Perform Software-in-the-Loop test for Navigation module
    model GNC_integrated, harness Navigation_SIL (for GNC_integrated/Navigation), mode Normal, start time 0, stop time 40
    signal scenario: inputs1 (Navigation_SIL/Signal Editor)
    baseline "outputs1.mat": abs tol 0.02
      KF_x
      KF_y
      KF_z
      KF_Vx
      KF_Vy
      KF_Vz
      KF_phi
      KF_theta
      KF_psi
      KF_p
      KF_q
      KF_r

  case "Test Case 2" [baseline]
    description: Perform Software-in-the-Loop test for Navigation module
    model GNC_integrated, harness Navigation_SIL (for GNC_integrated/Navigation), mode Normal, start time 0, stop time 200
    signal scenario: inputs2 (Navigation_SIL/Signal Editor)
    baseline "outputs2.mat": abs tol 0.04
      KF_x
      KF_y
      KF_z
      KF_Vx
      KF_Vy
      KF_Vz
      KF_phi
      KF_theta
      KF_psi
      KF_p
      KF_q
      KF_r