# Requirement set model_reqs (R2023a)

## 1 [Ver-DroMod-01] Motor response
The drone model shall include a motor response estimation accurate within 0.001% error.

## 2 [Ver-DroMod-02] Normal force accuracy
The drone model shall include a normal force estimation accurate within 0.001% error.

## 3 [Ver-DroMod-03] Gravity
The drone model shall include a gravity force estimation accurate within 0.001%.

## 4 [Ver-DroMod-04] Airdrag
The drone model shall include an airdrag force estimation accurate within 0.001%.