test file "test_model"

suite "Test-Ver-DroMod"

  case "Test-Ver-DroMod-01" [baseline]
    model drone_model, harness harness_motors
    baseline "motor_response_baseline.mat": rel tol 1e-05
      Clock
      <omega_1_meas>
      <omega_2_meas>
      <omega_3_meas>
      <omega_4_meas>
      <omega_5_meas>
      <omega_6_meas>
      <omega_7_meas>
      <omega_8_meas>

  case "Test-Ver-DroMod-02" [baseline]
    model drone_model, harness test_normal
    baseline "normal_baseline.mat"
      Clock
      <Nx>
      <Ny>
      <Nz>

  case "Test-Ver-DroMod-03" [baseline]
    model drone_model, harness test_gravity
    baseline "gravity_baseline.mat"
      Clock
      system output:1
      Output:1
      Output1:1

  case "Test-Ver-DroMod-04" [baseline]
    model drone_model, harness test_airdrag
    baseline "airdrag_baseline.mat"
      Clock
      system output:1
      system output1:1
      system output2:1